# Grasshopper definition 04.gh (Grasshopper 0.9.76)

进深 = Slider(12.775, range=-10..100)
curve = Curve(<curve referenced from the Rhino model>)
param_viewer = ParamViewer(curve)
panel = Panel(curve)
evaluate_length = EvaluateLength(Curve=curve, Length=Slider(0.374, range=0..1), Normalized=True)  # -> Point, Tangent, Parameter
division = Division(A=进深, B="2")
negative = Negative(Value=division)
vector_display = VectorDisplay(Anchor=evaluate_length.Point, Vector=evaluate_length.Tangent)
line_sdl = LineSDL(Start=evaluate_length.Point, Direction=evaluate_length.Tangent, Length=Slider(17.12, range=0..100))
entwine = Entwine(Branch00=division, Branch01=negative, FlattenInputs=True)
panel_2 = Panel(entwine)
panel_3 = Panel(line_sdl)
offset = Offset(Curve=line_sdl, Distance=entwine, Plane=PlaneXY(0, 0, 0), Corners=1)
divide_curve = DivideCurve(Curve=offset, Count=Slider(3, range=0..10), Kinks=False)  # -> Points, Tangents, Parameters
number_slider = Slider(4.89, range=0..10)
end_points = EndPoints(Curve=offset)  # -> Start, End
unit_z = UnitZ(Factor=1)
param_viewer_2 = ParamViewer(offset)
panel_4 = Panel(end_points.End)

flatten_tree = FlattenTree(Tree=divide_curve.Points, Path="{0}")
panel_5 = Panel(flatten_tree)
list_item = ListItem(List=flatten_tree, Index=Slider(0, range=0..10), Wrap=True)
deconstruct = Deconstruct(Point=flatten_tree)  # -> XComponent, YComponent, ZComponent
deconstruct_2 = Deconstruct(Point=list_item)  # -> XComponent, YComponent, ZComponent
entwine_2 = Entwine(Branch00=deconstruct.XComponent, Branch01=deconstruct.YComponent, Branch02=deconstruct.ZComponent, FlattenInputs=True)
entwine_3 = Entwine(
    Branch00=deconstruct_2.XComponent,
    Branch01=deconstruct_2.YComponent,
    Branch02=deconstruct_2.ZComponent,
    FlattenInputs=True)
param_viewer_3 = ParamViewer(entwine_2)
param_viewer_4 = ParamViewer(entwine_3)
param_viewer_5 = ParamViewer(flatten_tree)
panel_8 = Panel(entwine_3)
subtraction = Subtraction(A=entwine_2, B=entwine_3)
graft_tree = GraftTree(Tree=flatten_tree, IncludeEmptyLists=True, IncludeNullItems=True)
param_viewer_6 = ParamViewer(graft_tree)
flip_matrix = FlipMatrix(Data=subtraction)
numbers_to_points = NumbersToPoints(Numbers=flip_matrix, Mask=4)
param_viewer_7 = ParamViewer(numbers_to_points)
panel_9 = Panel(numbers_to_points)
text_tag_3d = TextTag3D(Location=graft_tree, Text=numbers_to_points, Size=Slider(0.287, range=0..1), Justification=7)

panel_11 = Panel(offset)
point = Point(divide_curve.Points)
entwine_4 = Entwine(Branch00=end_points.Start, Branch01=end_points.End, FlattenInputs=True)
# 柱axis
line_sdl_2 = LineSDL(Start=point, Direction=unit_z, Length=number_slider)
panel_12 = Panel(point)
polyline = PolyLine(Vertices=entwine_4, Closed=False)
curve_2 = Curve(polyline)
panel_13 = Panel(entwine_4)
evaluate_length_2 = EvaluateLength(Curve=curve_2, Length=Slider(0.5, range=0..1), Normalized=True)  # -> Point, Tangent, Parameter
addition = Addition(A=number_slider, B=Slider(2.549, range=0..10))
param_viewer_8 = ParamViewer(line_sdl_2)
unit_z_2 = UnitZ(Factor=1)
evaluate_length_3 = EvaluateLength(Curve=line_sdl_2, Length=Slider(1, range=0..1), Normalized=True)  # -> Point, Tangent, Parameter
pipe = Pipe(Curve=line_sdl_2, Radius=Slider(0.162, range=0..1), Caps=0)
panel_14 = Panel(polyline)
cap_holes = CapHoles(Brep=pipe)
param_viewer_9 = ParamViewer(evaluate_length_3.Point)
line_sdl_3 = LineSDL(Start=evaluate_length_2.Point, Direction=unit_z_2, Length=addition)
polyline_2 = PolyLine(Vertices=evaluate_length_3.Point, Closed=False)
evaluate_length_4 = EvaluateLength(Curve=line_sdl_3, Length=Slider(1, range=0..1), Normalized=True)  # -> flatten(Point), Tangent, Parameter
end_points_2 = EndPoints(Curve=polyline_2)  # -> Start, End
panel_15 = Panel(entwine_2)
param_viewer_10 = ParamViewer(evaluate_length_4.Point)
flatten_tree_2 = FlattenTree(Tree=polyline_2, Path="{0}")
polyline_3 = PolyLine(Vertices=evaluate_length_4.Point, Closed=False)
entwine_5 = Entwine(Branch00=end_points_2.Start, Branch01=end_points_2.End, FlattenInputs=True)
panel_16 = Panel(subtraction)
polyline_4 = PolyLine(Vertices=entwine_5, Closed=False)
panel_17 = Panel(polyline_3)
insert_items = InsertItems(List=flatten_tree_2, Item=polyline_3, Indices=expr("1", 1), Wrap=True)
panel_18 = Panel(flatten_tree_2)
panel_19 = Panel(flip_matrix)
number_slider_2 = Slider(1.88, range=0..10)
divide_curve_2 = DivideCurve(Curve=insert_items, Count=Slider(9, range=0..30), Kinks=False)  # -> Points, Tangents, Parameters
panel_20 = Panel(insert_items)
number_slider_3 = Slider(1.72, range=0..10)
flip_matrix_2 = FlipMatrix(Data=divide_curve_2.Points)
param_viewer_11 = ParamViewer(divide_curve_2.Points)
polyline_5 = PolyLine(Vertices=flip_matrix_2, Closed=False)
extend_curve = ExtendCurve(Curve=insert_items, Type=0, Start=number_slider_2, End=number_slider_2)
panel_21 = Panel(divide_curve_2.Points)
extend_curve_2 = ExtendCurve(Curve=polyline_5, Type=0, Start=number_slider_3, End=number_slider_3)  # -> flatten(Curve)

simplify_curve = SimplifyCurve(Curve=extend_curve)  # -> Curve, Simplified
loft_options = LoftOptions(Closed=False, Adjust=False, Rebuild=0, Refit=0, Type=3)
control_points = ControlPoints(Curve=simplify_curve.Curve)  # -> Points, Weights, Knots
polyline_6 = PolyLine(Vertices=control_points.Points, Closed=False)  # -> flatten(Polyline)
param_viewer_12 = ParamViewer(polyline_6)
loft = Loft(Curves=polyline_6, Options=loft_options)

param_viewer_13 = ParamViewer(extend_curve_2)
panel_22 = Panel(flip_matrix_2)
number_slider_4 = Slider(0.09, range=0..1)
number_slider_5 = Slider(0.192, range=0..1)
evaluate_length_5 = EvaluateLength(Curve=extend_curve_2, Length=Slider(0, range=0..1), Normalized=True)  # -> Point, Tangent, Parameter
construct_domain = ConstructDomain(DomainStart=number_slider_4, DomainEnd=expr("-x", number_slider_4))
construct_domain_2 = ConstructDomain(DomainStart=number_slider_5, DomainEnd=expr("-x", number_slider_5))
curve_frame = CurveFrame(Curve=extend_curve_2, Parameter=evaluate_length_5.Parameter)
deconstruct_plane = DeconstructPlane(Plane=curve_frame)  # -> Origin, XAxis, YAxis, ZAxis
plane_normal = PlaneNormal(Origin=evaluate_length_5.Point, ZAxis=deconstruct_plane.XAxis)
curve_3 = Curve(extend_curve_2)
rectangle = Rectangle(Plane=plane_normal, XSize=construct_domain, YSize=construct_domain_2, Radius=0)  # -> Rectangle, Length
vector_display_ex = VectorDisplayEx(Point=evaluate_length_5.Point, Vector=deconstruct_plane.XAxis, Colour=RGB(0, 0, 0), Width=2)
graft_tree_2 = GraftTree(Tree=rectangle.Rectangle, IncludeEmptyLists=True, IncludeNullItems=True)
loft_2 = Loft(Options={Adjust=False, Closed=False, LoftEnds=0, LoftSimp=0, LoftType=0, Rebuild=10, Refit=0.01})
param_viewer_14 = ParamViewer(rectangle.Rectangle)
sweep1 = Sweep1(Rail=graft(curve_3), Sections=graft(rectangle.Rectangle), Miter=1)
param_viewer_15 = ParamViewer(graft_tree_2)
cap_holes_2 = CapHoles(Brep=sweep1)
